# Grasshopper definition parallel coordinates graph.gh (Grasshopper 1.0.7)
# Copyright: Co-de-iT
# plug-ins: froGH, Human

# parallel coordinates data.csv
panel = Panel("parallel coordinates big data.csv")
f_ghfilepath = GHFilePathInfo()  # -> FileName, FilePath
concat = Concatenate(FragmentA=f_ghfilepath.FilePath, FragmentB=panel)
# <title>
# 
# <description>
# 
# code by Alessio Erioli
# 
# v 0.1
file = ReadFile(File=concat, PerLineParse=True)
# © a3 2021 / Creative Commons Attribution-Non Commercial-ShareAlike 4.0 International License
split = TextSplit(Text=file, Separators=",")  # -> simplify(Result)
column_span = Slider(12.139, range=0..50)
graph_height = Slider(14.556, range=0..50)
split_2 = SplitList(List=split, Index="1")  # -> ListA, ListB
flip = FlipMatrix(Data=split_2.ListB)  # -> simplify(Data)
split_3 = SplitList(List=flip, Index="1")  # -> ListA, ListB
split_4 = SplitList(List=flatten(split_2.ListA), Index="1")  # -> ListA, simplify(graft(ListB))
lng = ListLength(List=flatten(split_3.ListA))
column_label_rotation = Slider(0, range=0..1.57)
column_label_span = Slider(1.048, range=0..10)
column_label_size = Slider(0.3, range=0..1)
column_labels = Panel(split_3.ListA)
bnd = Bounds(Numbers=split_3.ListB)
row_labels = Panel(split_4.ListB)
series = Series(Start=0, Step=column_span, Count=lng)
remap = RemapNumbers(Value=split_3.ListB, Source=bnd, Target=Domain(0, 1))  # -> Mapped, Clipped
pt = ConstructPoint(XCoordinate=series, YCoordinate=0, ZCoordinate=0)

# ---- group: shortlist by data intervals
number_slider = Slider(0, range=0..3)
t1 = Slider(0.576, range=0..1)
t0 = Slider(0.393, range=0..1)
item = ListItem(List=flatten(split_3.ListA), Index=number_slider, Wrap=True)
tstat = TreeStatistics(Tree=split_3.ListB)  # -> Paths, Length, Count
item_2 = ListItem(List=tstat.Paths, Index=number_slider, Wrap=True)
data_label = Panel(item)
branch = TreeBranch(Tree=split_3.ListB, Path=item_2, MaintainPaths=True)
bnd_2 = Bounds(Numbers=branch)
c_script = CSharpScript(I=bnd_2, t=t0)  # -> V; inputs t: Double
# ---------- c_script: C# ----------
    V = I.ParameterAt(t);
# ---------- end c_script ----------
c_script_2 = CSharpScript(I=bnd_2, t=t1)  # -> V; inputs t: Double; same code as c_script
panel_2 = Panel(bnd_2)
dom = ConstructDomain(DomainStart=c_script, DomainEnd=c_script_2)
restricted_values = Panel(dom)
inc = Includes(Value=branch, Domain=dom)  # -> Includes, Deviation

# ----
Y = UnitY(Factor=1)

# ---- group: column lines
line = LineSDL(Start=pt, Direction=Y, Length=graph_height)

# ----
swatch = ColourSwatch(SwatchColor=RGB(0, 0, 0))

# ---- group: column labels
addition = Addition(A=graph_height, B=column_label_span)
Y_2 = UnitY(Factor=addition)
move = Move(Geometry=pt, Motion=Y_2)  # -> Geometry, Transform
xy = XYPlane(Origin=move.Geometry)
prot = RotatePlane(Plane=xy, Angle=column_label_rotation)  # -> graft(Plane)
tag = TextTag3D(Location=prot, Text=split_3.ListA, Size=column_label_size, Colour=swatch, Justification=8)

# ----
crv = Curve(reparameterize(graft(line)))
previewlw = CustomPreviewLineweights(Geometry=line, Shader=swatch, Absolute=False)
eval = EvaluateCurve(Curve=crv, Parameter=remap.Mapped)  # -> Point, Tangent, Angle
flip_2 = FlipMatrix(Data=eval.Point)

# ---- group: graph polylines
pline = PolyLine(Vertices=flip_2, Closed=False)  # -> flatten(Polyline)
lng_2 = ListLength(List=flatten(pline))  # -> expr("x-1", Length)
range = Range(Domain=Domain(0, 1), Steps=lng_2)
gradient = Gradient(LowerLimit=0, UpperLimit=1, Parameter=range, stops=[0: RGB(255, 0, 0), 0.496: RGB(171, 171, 171), 1: RGB(42, 0, 255)])
previewlw_2 = CustomPreviewLineweights(Geometry=pline, Shader=gradient, Thickness="1", Absolute=False)

# ---- group: data text
data_text_size = Slider(0.1, range=0..1)
tag_2 = TextTag3D(Location=eval.Point, Text=split_3.ListB, Size=data_text_size, Colour=swatch, Justification=8)

# ---- group: row labels
row_labels_span = Slider(-1, range=-10..-1)
row_label_size = Slider(0.2, range=0..1)
item_3 = ListItem(List=flip_2, Index=0, Wrap=True)
X = UnitX(Factor=row_labels_span)
move_2 = Move(Geometry=item_3, Motion=X)  # -> Geometry, Transform
tag_3 = TextTag3D(Location=move_2.Geometry, Text=split_4.ListB, Size=row_label_size, Colour=graft(gradient), Justification=9)

# ---- group: highlight single curve
multiplication = Multiplication(A=lng_2, B=Slider(0.97, range=0..1))
int = Integer(multiplication)
panel_3 = Panel(int)
item_4 = ListItem(List=pline, Index=int, Wrap=True)
item_5 = ListItem(List=gradient, Index=int, Wrap=True)
previewlw_3 = CustomPreviewLineweights(Geometry=item_4, Shader=item_5, Thickness="8", Absolute=False)

# ----
cull = CullPattern(List=pline, CullPattern=inc.Includes)
previewlw_4 = CustomPreviewLineweights(Geometry=cull, Shader=ColourSwatch(SwatchColor=RGB(42, 163, 31)), Thickness="3", Absolute=False)
