# Grasshopper definition 00-02_base 1 object_Assemblage random + associate geometry.gh (Grasshopper 1.0.7)
# Copyright: Co-de-iT
# plug-ins: Assembler, EleFront, Human

# ----
# try and modify this value to see what changes
angle = Slider(90, range=0..180)

# ----
# © Co-de-iT 2021 / Creative Commons Attribution-Non Commercial-ShareAlike 4.0 International License
# ASSEMBLAGES IN BRIEF: GENERAL DESCRIPTION (WHAT TO DO)
# 
# . choose WHERE to add next object and WHICH object to add
# 
# 
# 
# PROCESS STEPS (HOW TO DO IT)
# 
# . select receiver object in the assemblage according to a given criteria
# 
# . list all possible combinations of free handles and related compatible candidates (based on the available rules)
# 
# . choose a winning candidate according to given criteria
# DEFINITION ANATOMY: 00 - constuct
# 
# Construct the object and relationships necessary for the Assemblage
# 
# 
# 
# 01 - simulate
# 
# Simulate the Assemblage growth
# 
# 
# 
# 02 - analyze/post-process
# 
# Analyze results and post-process the obtained assemblage
# 0 - construct
# construct Handles
# type 1
# Rotations: Each handle must have one or more rotations assigned (in degrees).
rotations = Panel("""0
90""")
# Type: Type qualifies the Handle compatibility (by default, only handles of the same type are compatible). Specify a number for each Handle.
type = Panel("1")
rotations_2 = Panel("""0
90""")
type_2 = Panel("1")
rotations_3 = Panel("""0
90""")
type_3 = Panel("1")
type_4 = Panel("1")
rotations_4 = Panel("0")
merge = Merge(Data1=rotations_4, Data2=angle)
crv = Curve(<curve referenced from the Rhino model>)
crv_2 = Curve(<curve referenced from the Rhino model>)
crv_3 = Curve(<curve referenced from the Rhino model>)
crv_4 = Curve(<curve referenced from the Rhino model>)

# ---- group: type 2
crv_5 = Curve(<curve referenced from the Rhino model>)

# ----
type_5 = Panel("2")
# type 2
rotations_5 = Panel("""0
180""")
handles = ConstructHandles(Polyline=crv_5, RotationAngles=rotations_5, Type=type_5)

# ----
# Assembler
# 
# Framework for Iterative Assemblages workflow
# 
# code by Alessio Erioli
# 
# v 1.0
# create an AssemblyObject: . object name
# . collision mesh
# . reference plane
# . direction vector
# . weight (optional)
# . Handles
crete_a_handle = Panel(""". L polyline
. rotations
. type
. weogth (optional)""")

# ---- group: Create Handle
handles_2 = ConstructHandles(Polyline=crv_3, RotationAngles=rotations_2, Type=type_2)

handles_3 = ConstructHandles(Polyline=crv_4, RotationAngles=merge, Type=type_4)

handles_4 = ConstructHandles(Polyline=crv, RotationAngles=rotations, Type=type)

handles_5 = ConstructHandles(Polyline=crv_2, RotationAngles=rotations_3, Type=type_3)

# ----
merge_2 = Merge(Data1=handles_4, Data2=handles_5, Data3=handles_2, Data4=handles_3, Data5=handles)
panel = Panel(merge_2)

# ---- group: Collision Mesh
# construct AssemblyObject
mesh = Mesh(<mesh referenced from the Rhino model>)

# ----
# display Handles
number_slider = Slider(0.1, range=0..0.5)

# ---- group: volume centroid
volume = Volume(Geometry=mesh)  # -> Volume, Centroid

# ----
weight_optional = Panel("1.0")
name = Panel("block_01")

# ---- group: reference plane
xy = XYPlane(Origin=volume.Centroid)

# ---- group: direction vector
X = UnitX(Factor=1)

# ---- group: actual geometry - mesh
mesh_2 = Mesh(<mesh referenced from the Rhino model>)

# ---- group: circulation path
crv_6 = Curve([<curve referenced from the Rhino model> x8])

# ----
rhino_block_id = Panel("block_01-mesh")
numeric_data = Panel("1.0")
merge_3 = Merge(Data1=rhino_block_id, Data2=numeric_data, Data3=mesh_2, Data4=crv_6)
xdcon = ConstructXData(Label="block_01 data", Data=merge_3, ReferencePlane=xy, AssemblyObjectNameReference=name)

# ---- group: Display Handles
handdisp = DisplayHandle(Handles=merge_2, DisplaySize=number_slider, absHTextSize=False)

# ---- group: Create AssemblyObject
aocon = ConstructAssemblyObject(Name=name, CollisionMesh=mesh, ReferencePlane=xy, Direction=X, Weight=weight_optional, Handles=merge_2, ZLockAO=False)

# ----
# generate heuristics rules
heuw = HeuristicsWriter(AssemblyObjectsSet=aocon, noSH=False, noSO=False, xHT=False)
heuristics_rules = Panel(heuw)
cell_size = Slider(1.2, range=1..2)

# ---- group: base point
pt = Point(Point(0, 20, 0))

# ----
step = Button()
reset = Button()

# ---- group: Heuristics Display
heud = HeuristicDisplay(
    OriginPoint=pt,
    AssemblyObjectsSet=aocon,
    XData=xdcon,
    HeuristicsString=heuw,
    XSize=cell_size,
    YSize=cell_size,
    NRows=Slider(10, range=10..50),
    DisplayType="S-R",
    ZLockFilter=False,
    OutputType="S-R")

# ----
pt_2 = Point(Point(0, -100, 0))

# ---- group: Random Assemblage Engine
# 1 - simulate
aoeng = AssemblerEngineSimple(
    AssemblyObjectsSet=aocon,
    StartingPlane=pt_2,
    StartingObjectType=0,
    HeuristicsString=heuw,
    Go=False,
    Step=step,
    NIterations=Slider(100, range=10..100),
    MaxNObjects="1000",
    Reset=reset)  # -> Assemblage, AssemblageCount

# ----
n_of_objects = Panel(aoeng.AssemblageCount)
aoadecon = DeconstructAssemblage(Assemblage=aoeng.Assemblage)  # -> AssemblageObjects, AssemblageRules, ReceiverObjectsIndexes, AvailableObjectIndexes, UnreachableObjectIndexes
# 2 - analyze/post-process
assemblyobjects = Panel(aoadecon.AssemblageObjects)
assemblage_rules = Panel(aoadecon.AssemblageRules)
receiver_object_index = Panel(aoadecon.ReceiverObjectsIndexes)
available_objects_indexes = Panel(aoadecon.AvailableObjectIndexes)
unreachable_objects_indexes = Panel(aoadecon.UnreachableObjectIndexes)
aoadisp = DisplayAssemblage(Assemblage=aoeng.Assemblage, Bypass=False, OutputType="Objects")  # -> ColoredCollisionMeshes, Edges, Colors
dam = DataDam(DataA=aoadecon.AssemblageObjects, BufferDelay=10000000, BufferMode=0)
mjoin = MeshJoin(Meshes=aoadisp.ColoredCollisionMeshes)
# associate actual geometry
# There are essentially 2 alternative methods:
# 
# 1. using geometry in XData
# 
# 2. using blocks (2 ways - needs Elefront)
line = Line(aoadisp.Edges)

# ----
# 1. associate geometry & more using XData
aoxd = AssociateXData(AssemblyObjects=dam, XData=xdcon)
xddecon = DeconstructXData(XData=aoxd)  # -> Label, Data, ReferencePlane, AssemblyObjectNameReference
panel_2 = Panel(xddecon.Data)
split = SplitList(List=xddecon.Data, Index="3")  # -> ListA, ListB
item = ListItem(List=split.ListA, Index=0, Wrap=True)  # -> Item, Item1, Item2
numeric_data_2 = Panel(item.Item1)
preview = CustomPreview(Geometry=item.Item2, Material=ColourSwatch(SwatchColor=RGB(122, 122, 122)))
# Blocks: see : tinyurl.com/rhino6blocks
# 
# for help on Blocks in Rhino.
# 
# Since the geometry is stored only once in the block definition and only transformation data (position, rotation, scale) is stored for each instance, they are recommended for assemblages with a large amount of AssemblyObjects (1000+).
# 
# The reference plane for a block is defined at the moment of creation, and it's the CPlane with origin in the point chosen as a base point.
# 
# A good strategy to ensure correct block alignment (used in this example) is to create the block alredy positioned as aligned as desired within the collision geometry, and use as a reference point the same point used for the AssemblyObject reference plane.
# 
# A good test is to insert the block you want to check using the AssemblyObject reference plane origin as insertion point. If the block aligns correctly things are OK, otherwise the block insertion point should be redefined.
# Blocks pro-con: PRO
# 
# . extremely lightweight
# . recommended in case of a large quantity of instances in the assemblage
# . blocks can propagate editing (replacement and/or modification), selectively or to all instances, even after baking
# 
# CON
# 
#  . blocks must be defined in Rhino
# . blocks must be defined so that they align with the collision geometry (this can be tricky)
# . need a plugin (like Elefront) and might take some seconds before showing a preview
previewlw = CustomPreviewLineweights(Geometry=split.ListB, Shader=ColourSwatch(SwatchColor=RGB(255, 255, 255)), Absolute=False)

# ----
# 2.1 associate actual geometry using blocks - v1
aoplane = ExtractReferencePlane(AssemblyObject=dam)
bake = BooleanToggle(False)

# ---- group: enable for preview
# What you see here in the preview are the collision meshes - if you remember from the previous example, they represent the OCCUPIED SPACE, you can consider them as placeholders, but they are not the actual, contained geometry.
# 
# So, how do I access/preview the ACTUAL geometry?
# 
# See below....
preview_2 = CustomPreview(Geometry=mjoin, Material=ColourSwatch(SwatchColor=RGB(255, 255, 255)))

# ----
# 2.2 associate actual geometry using blocks - v2
index_of_blockid_in_xdata = Panel("0")
item_2 = ListItem(List=xddecon.Data, Index=index_of_blockid_in_xdata, Wrap=True)
bake_2 = BooleanToggle(False)
inblock = InsertBlock(BlockName=item_2, SourcePlane=PlaneXY(0, 0, 0))
# If you have a more complex setup (multiple objects, ect.) the block name can be passed through XData and retrieved after the assemblage process.
bake_3 = BakeObjects(Geometry=inblock, Bake=bake_2)

# ---- group: apply blocks
panel_3 = Panel("block_01")
inblock_2 = InsertBlock(BlockName="block_01-mesh", SourcePlane=PlaneXY(0, 0, 0))
# in case of simple setups (like this one, only one AssemblyObject), the block ID can be fetched via manual input.
bake_4 = BakeObjects(Geometry=inblock_2, Bake=bake)

# ----
# Display lo-res geometry via XData
panel_4 = Panel("2")  # disabled
item_3 = ListItem(List=xddecon.Data, Index=panel_4, Wrap=True)  # disabled
preview_3 = CustomPreview(Geometry=item_3, Material=graft(aoadisp.Colors))  # disabled

block_id = Panel(item.Item)
