# Grasshopper definition circulation path operations.gh (Grasshopper 1.0.7)
# Copyright: Co-de-iT
# plug-ins: Shortest Walk in Gh, Human, Assembler, froGH

plugins_needed = Panel(""". froGH
. Human""")
# XData must contain line network for circulation
associated_xdata = Relay()
assemblage = Relay()
xddecon = DeconstructXData(XData=associated_xdata)  # -> Label, simplify(Data), ReferencePlane, AssemblyObjectNameReference
# Assembler
# 
# Framework for Iterative Assemblages workflow
# 
# code by Alessio Erioli
# 
# v 1.0
# © Co-de-iT 2021 / Creative Commons Attribution-Non Commercial-ShareAlike 4.0 International License
# circulation path operations
aoadecon = DeconstructAssemblage(Assemblage=assemblage)  # -> AssemblageObjects, AssemblageRules, ReceiverObjectsIndexes, AvailableObjectIndexes, UnreachableObjectIndexes

# ---- group: path topology
line = Line(flatten(xddecon.Data))
f_tln = Topologizer(LinesNetwork=line, Decimals=3)  # -> Points, LinePointsData, PointsConnectivity, LineDirectionAtEachPoint

# ----
f_clstr = Clusterizer(TopologyData=f_tln.PointsConnectivity)

# ---- group: highlight clusters
f_tinv = TopologyInverter(TopologyData=f_tln.LinePointsData)
item = ListItem(List=line, Index=f_tinv, Wrap=True)
tstat = TreeStatistics(Tree=f_clstr)  # -> Paths, Length, Count
group = Group(Objects=item)  # -> flatten(Group)
n_of_clusters = Panel(tstat.Count)
item_2 = ListItem(List=group, Index=f_clstr, Wrap=True)

# ---- group: isolate horizontal and vertical paths
Z = UnitZ(Factor=1)
angle = Angle(VectorA=line, VectorB=Z)  # -> Angle, Reflex
similar = Similarity(FirstNumber=angle.Angle, SecondNumber="0", Threshold=0.1)  # -> Similarity, AbsoluteDifference
similar_2 = Similarity(FirstNumber=angle.Angle, SecondNumber="0.5", Threshold=0.1)  # -> Similarity, AbsoluteDifference
cull = CullPattern(List=line, CullPattern=similar.Similarity)
cull_2 = CullPattern(List=line, CullPattern=similar_2.Similarity)

# ---- group: shortest walk between points / end point
pt = Point()

# ---- group: shortest walk between points / start point
pt_2 = Point()

# ---- group: shortest walk between points
cp = ClosestPoint(Point=pt_2, Cloud=f_tln.Points)  # -> ClosestPoint, CPIndex, Distance
cp_2 = ClosestPoint(Point=pt, Cloud=f_tln.Points)  # -> ClosestPoint, CPIndex, Distance
ln = Line(StartPoint=cp.ClosestPoint, EndPoint=cp_2.ClosestPoint)
shortwalk = ShortestWalk(Curves=line, WantedPath=ln)  # -> ShortestWalk, Succession, Direction, Length

# ---- group: display clusters
wheel = ColourWheel(
    tstat.Count,
    ColourGrips_Style=10,
    ColourGrips_Grip=[3.34820233, 2.094395102, 4.188790205, 3.141592654],
    ColourGrips_Lum=[0.1, 0.6959162562],
    ColourGrips_Range=[0.2980456393, 0.2980456393, 0.2980456393, 0.2980456393],
    ColourGrips_Sat=[0.1889716777, 0.7131070986])
previewlw = CustomPreviewLineweights(Geometry=item_2, Shader=graft(wheel), Thickness="3", Absolute=False)

# ----
previewlw_2 = CustomPreviewLineweights(Geometry=shortwalk.ShortestWalk, Shader=ColourSwatch(SwatchColor=RGB(255, 0, 0)), Thickness="5", Absolute=False)

# ---- group: objects involved in shortest path
f_ifroml = IndexesFromList(Data=line)
unflatten = UnflattenTree(Tree=f_ifroml, Guide=xddecon.Data)
mindex = MemberIndex(Set=unflatten, Member=shortwalk.Succession)  # -> Index, simplify(Count)
ma = MassAddition(Input=mindex.Count)  # -> Result, PartialResults
larger = LargerThan(FirstNumber=ma.Result, SecondNumber="0")  # -> flatten(LargerThan), OrEqualTo
f_ifroml_2 = IndexesFromList(Data=larger.LargerThan)
cull_3 = CullPattern(List=f_ifroml_2, CullPattern=larger.LargerThan)

# ---- group: display circulation paths
previewlw_3 = CustomPreviewLineweights(Geometry=line, Shader=ColourSwatch(SwatchColor=RGB(237, 85, 194)), Thickness="2", Absolute=False)

# ----
item_3 = ListItem(List=aoadecon.AssemblageObjects, Index=cull_3, Wrap=True)
panel = Panel(cull_3)
aocmesh = ExtractCollisionMesh(AssemblyObject=item_3)

# ---- group: shortest path polyline
crv = Curve(shortwalk.ShortestWalk)

# ---- group: shortlisted objects
int = Integer(cull_3)
