# Grasshopper definition random place people.gh (Grasshopper 1.0.7)
# Copyright: Co-de-iT
# plug-ins: MeshEdit Components, EleFront

rectangle = Rectangle(Plane=PlaneXY(0, 0, 0), XSize=Slider(30, range=0..100), YSize=Slider(40, range=0..100), Radius=0)  # -> Rectangle, Length
pop2d = Populate2D(Region=rectangle.Rectangle, Count="200", Seed=1)
list = ValueList({"from existing geometry": 0, "from plane selection": 1}, selected="from existing geometry")
names_of_blocks_to_place = Panel("""Umarell
Zdoura""")

# ----
# from baked mesh assemblage
# blocks will be placed on surfaces of area greater than this amount
mesh = Mesh(<mesh referenced from the Rhino model>)
explode = MeshExplode(Mesh=mesh, Interpolate=False)
# Assembler
# 
# Framework for Iterative Assemblages workflow
# 
# code by Alessio Erioli
# 
# v 1.0
# © Co-de-iT 2021 / Creative Commons Attribution-Non Commercial-ShareAlike 4.0 International License
facen = FaceNormals(Mesh=explode)  # -> flatten(Centers), flatten(Normals)

# ---- group: pick horizontal faces, normals up
Z = UnitZ(Factor=1)
angle = Angle(VectorA=facen.Normals, VectorB=Z)  # -> Angle, Reflex
smaller = SmallerThan(FirstNumber=angle.Angle, SecondNumber="0.005")  # -> SmallerThan, OrEqualTo

# ---- group: area threshold
area = MeshArea(Mesh=explode)  # -> Area, Centroid
larger = LargerThan(FirstNumber=area.Area, SecondNumber="10")  # -> LargerThan, OrEqualTo

# ----
and = GateAnd(A=smaller.SmallerThan, B=larger.LargerThan)

# ---- group: select faces and random reduce
cull = CullPattern(List=facen.Centers, CullPattern=and)
reduce = RandomReduce(List=cull, Reduction=Slider(250, range=0..1000), Seed=1)
xy = XYPlane(Origin=reduce)

# ----
filter = StreamFilter(Gate=list, Stream0=xy, Stream1=pop2d)
pln = Plane(filter)
lng = ListLength(List=pln)

# ---- group: randomize rotation and displacement from center
random = Random(Range="0 to 2*Pi", Number=lng, Seed=2, Integers=False)
displace_amount = Slider(0.961, range=0..1)
prot = RotatePlane(Plane=pln, Angle=random)
deplane = DeconstructPlane(Plane=prot)  # -> Origin, XAxis, YAxis, ZAxis
multiplication = Multiplication(A=deplane.XAxis, B=displace_amount)
move = Move(Geometry=prot, Motion=multiplication)  # -> Geometry, Transform

# ----
random_2 = Random(Range=Domain(0, 1), Number=lng, Seed=2, Integers=True)
item = ListItem(List=names_of_blocks_to_place, Index=random_2, Wrap=True)

# ---- group: summon blocks and bake them
bake = BooleanToggle(False)
inblock = InsertBlock(BlockName=item, SourcePlane=move.Geometry)
bake_2 = BakeObjects(Geometry=inblock, Bake=bake)
